# Grasshopper definition Spikey_Ring_hops dm_test mod.gh (Grasshopper 1.0.7)
# Spherical spikey thing

cell_radius = Slider(6.99, range=0..10)
branch_length = Slider(10, range=0..10)
radius = GetNumber(
    cell_radius,
    AtLeast=1,
    AtMost=1,
    Maximum=1.797693135e+308,
    Minimum=-1.797693135e+308,
    Prompt="Base radius",
    TreeAccess=False)
length = GetNumber(
    branch_length,
    AtLeast=1,
    AtMost=1,
    Maximum=1.797693135e+308,
    Minimum=-1.797693135e+308,
    Prompt="Spike length",
    TreeAccess=False)
count = GetInteger(
    Slider(25, range=1..3000),
    AtLeast=1,
    AtMost=1,
    Maximum=1000,
    Minimum=-2147483648,
    Prompt="Number of spikes",
    TreeAccess=False)
pt = ConstructPoint(XCoordinate=0, YCoordinate=0, ZCoordinate=0)
cyl = Cylinder(Base=pt, Radius=radius, Length=1)
popgeo = PopulateGeometry(Geometry=cyl, Count=count, Seed=1)
facet = FacetDome(Points=popgeo, Radius=radius)  # -> Pattern, Dome
explode = Explode(Curve=facet.Pattern, Recursive=True)  # -> Segments, Vertices
curvepoint = PointOnCurve(explode.Segments, parameter=0.443)
avr = Average(Input=curvepoint)
lng = ListLength(List=explode.Segments)
vec2pt = Vector2Pt(PointA=pt, PointB=avr, Unitize=invert(False))  # -> Vector, Length
amp = Amplitude(Vector=vec2pt.Vector, Amplitude=length)
addition = Addition(A=avr, B=amp)
end = EndPoints(Curve=graft(explode.Segments))  # -> Start, End
dup = DuplicateData(Data=addition, Number=lng, Order=True)
pshift = ShiftPaths(Data=dup, Offset=-1)  # -> graft(Data)
merge = Merge(Data1=end.Start, Data2=end.End, Data3=pshift)
triangle = MeshTriangle(CornerA=0, CornerB=1, CornerC=2)
conmesh = ConstructMesh(Vertices=merge, Faces=triangle)
mjoin = MeshJoin(Meshes=flatten(conmesh))
alignvert = AlignVertices(Mesh=mjoin, Tolerance=0.1)  # -> Result, Count
weld = WeldMesh(Mesh=alignvert.Result, Angle=3.141592654)
subdmesh = SubDFromMesh(Mesh=weld, Creases=1, Corners=1, Interpolate=False)
subd = SubD(subdmesh)
rh_out_subd = SubD(subd)
context_bake = ContextBake(Geometry=subd)
