# Grasshopper definition Spikey_hops dm linked to GitHub.gh (Grasshopper 1.0.7)
# plug-ins: Hops

# https://github.com/iaac-macad/bimsc24-datamgmt-session01/raw/main/Session01/Spikey.gh
number_slider = Slider(10, range=0..10)
panel = Panel("https://github.com/AnnaDelMonaco/bimsc24-datamgmt-session01_Anna/raw/main/Spikey_Ring_hops%20dm_test%20mod.gh")
dup = DuplicateData(Data=Slider(100, range=0..100), Number=Slider(100, range=0..100), Order=True)
hops = Hops(
    _Path=panel,
    Radius=number_slider,
    Count=Slider(1000, range=0..1000),
    Length=Slider(10, range=0..10),
    CacheResultsInMemory=True,
    CacheSolveResults=True,
    RemoteDefinitionLocation="https://github.com/AnnaDelMonaco/bimsc24-datamgmt-session01_Anna/raw/main/Spikey_Ring_hops%20dm_test%20mod.gh",
    RemoteSolveVersion=(0, 1, 0),
    ShowInput_Enabled=False,
    ShowInput_Path=True,
    SynchronousSolve=True)  # -> SubD, SubD_2
